# Grasshopper definition parametric generated dataset_upload.gh (Grasshopper 1.0.8)
# plug-ins: RhinoCodePluginGH, Heteroptera, Pufferfish, KUKA|prc - parametric robot control

number_slider = Slider(4621, range=0..5000)
seed = Integer(number_slider)

# ---- group: size and position of canvas
rectangle = Rectangle(Plane="12,-660,0", XSize="90", YSize="90", Radius=0)  # -> Rectangle, Length

# ----
boolean_toggle = BooleanToggle(False)

# ----
# Auto-save XML file
py3 = Python3Script(seed=seed, x=boolean_toggle)  # -> out, a
# ---------- py3: Python ----------
"""Rename GH_Kuka.xml based on seed input.

Input:
    seed: integer or string used to label the saved XML file
"""

import os
import shutil

if x == True: 
    # Define the folder and file paths
    base_path = r"D:\TUD\Q5-creative robots\code_ML_2\dataset generation"
    original_file = os.path.join(base_path, "kukaprc_data.xml")

    # Construct the new filename
    new_filename = f"motion\\{seed}.xml"
    new_path = os.path.join(base_path, new_filename)

    # Check if the original file exists
    if os.path.exists(original_file):
        try:
            shutil.copy2(original_file, new_path)
            print(f"Saved: {new_filename}")
        except Exception as e:
            print(f"Error copying file: {e}")

    else:
        print("GH_Kuka.xml not found in target directory.")

else:
    print('press True to trigger')
# ---------- end py3 ----------
panel = Panel(py3.out)

# ----
# Auto-save img
panel_2 = Panel("D:\TUD\Q5-creative robots\code_ML_2\dataset generation\img")
number_slider_2 = Slider(512, range=0..1000)
captureview = LBCaptureView(
    file_name=number_slider,
    folder=panel_2,
    viewport="Top",
    width=number_slider_2,
    height=number_slider_2,
    capture=boolean_toggle)  # -> Output; plug-in component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
panel_3 = Panel(captureview)

# ---- group: proximity network
# Construct Stroke Skeleton
number_slider_3 = Slider(100, range=0..100)
random = Random(Range=Domain(0, 1000), Number=1, Seed=seed)
addition = Addition(A=seed, B=random)
pop2d = Populate2D(Region=rectangle.Rectangle, Count=number_slider_3, Seed=addition)

# ---- group: control point and direction path
offset = OffsetCurve(Curve=rectangle.Rectangle, Distance="-15", Corners=1)
pop2d_2 = Populate2D(Region=offset, Count=Slider(4, range=2..7), Seed=seed)
item = ListItem(List=pop2d_2, Index=0, Wrap=True)
ptsortitems = PointSortItems(Start=item, Points=pop2d_2)  # -> SortedItems, SortedIndices, SortedPoints
intcrv = Interpolate(Vertices=ptsortitems.SortedPoints, Degree=3, Periodic=False, KnotStyle=1)  # -> Curve, Length, Domain

# ---- group: proximity network / Network of lines connecting points
network = ProximityNetwork(Points=pop2d, Distance=Slider(14, range=0..100), Number=Slider(5, range=0..10))  # -> PointPointTopology, ConnectionPointTopology, Lines

# ---- group: Path direction
pathfinder = NetworkPathFinder(Points=pop2d, PointPointTopology=network.PointPointTopology, Curves=intcrv.Curve)  # -> Path, Index

# ---- group: interpolate and reconstruct curve
disc = Discontinuity(Curve=pathfinder.Path, Level=1)  # -> Points, Parameters
intcrv_2 = Interpolate(Vertices=disc.Points, Degree=3, Periodic=False, KnotStyle=1)  # -> Curve, Length, Domain
number_slider_4 = Slider(5, range=0..15)

# ---- group: interpolate and reconstruct curve / Main Drawn Curve Path on xy Plane
rebcrv = RebuildCurve(Curve=intcrv_2.Curve, Count=number_slider_4, EndTangents=False)

# ---- group: Extract control points for moving upward
# Construct Robot Moving Curve
# last point always move upward
control_points = ControlPoints(Curve=rebcrv)  # -> Points, Weights, Knots
list_length = ListLength(List=control_points.Points)
count_of_going_up = Slider(3, range=1..3)
construct_domain = ConstructDomain(DomainStart=0, DomainEnd=expr("x-2", list_length))
random_2 = Random(Range=construct_domain, Number=count_of_going_up, Seed=seed, Integers=True)
list_last_item = ListItem(List=control_points.Points, Index=expr("x-1", list_length), Wrap=True)
list_item = ListItem(List=control_points.Points, Index=random_2, Wrap=True)
entwine = Entwine(Branch00=list_item, Branch01=list_last_item, FlattenInputs=True)  # -> flatten(Result)

# ----
bursh_thickness_radius_max_mm = Slider(8.2, range=0..10)
bursh_thickness_radius_min_mm = Slider(2, range=0..10)
max_z_mm = Slider(3, range=0..10)

# ---- group: point moving upward
construct_domain_2 = ConstructDomain(DomainStart=0, DomainEnd=max_z_mm)
random_3 = Random(Range=construct_domain_2, Number=count_of_going_up, Seed=seed, Integers=False)
entwine_2 = Entwine(Branch00=random_3, Branch01=max_z_mm, FlattenInputs=True)  # -> flatten(Result)
unit_z = UnitZ(Factor=entwine_2)
move = Move(Geometry=entwine, Motion=unit_z)  # -> Geometry, Transform

# ---- group: Replace the control points and construct curve
list_length_2 = ListLength(List=random_2)
subtraction = Subtraction(A=list_length, B=Slider(1, range=0..1))
insert_items = InsertItems(List=random_2, Item=subtraction, Indices=list_length_2, Wrap=True)
replace_items = ReplaceItems(List=control_points.Points, Item=move.Geometry, Indices=insert_items, Wrap=False)

# ---- group: Replace the control points and construct curve / Motion Curve
nurbs_curve = NurbsCurve(Vertices=replace_items, Degree=3, Periodic=False)  # -> Curve, Length, Domain

# ---- group: start/end point vector (rotate plane angle)
offset_2 = OffsetCurve(Curve=rectangle.Rectangle, Distance="150", Corners=1)
Z = UnitZ(Factor="400")
number_slider_5 = Slider(2, range=0..10)
move_2 = Move(Geometry=offset_2, Motion=Z)  # -> Geometry, Transform
pop2d_3 = Populate2D(Region=move_2.Geometry, Count=number_slider_5, Seed=seed)
divide = DivideCurve(Curve=nurbs_curve.Curve, Count=expr("x-1", number_slider_5), Kinks=False)  # -> Points, Tangents, Parameters
vec2pt = Vector2Pt(PointA=divide.Points, PointB=pop2d_3, Unitize=False)  # -> Vector, Length

# ---- group: find a brushstroke thickness
construct_domain_3 = ConstructDomain(DomainStart=bursh_thickness_radius_min_mm, DomainEnd=bursh_thickness_radius_max_mm)
random_4 = Random(Range=construct_domain_3, Number=1, Seed=seed)

# ---- group: no. of target planes along the curve
number_slider_6 = Slider(45, range=0..1000)

# ---- group: extract z mm
divide_curve = DivideCurve(Curve=reparameterize(nurbs_curve.Curve), Count=number_slider_6, Kinks=False)  # -> Points, Tangents, Parameters
deconstruct = Deconstruct(Point=divide_curve.Points)  # -> XComponent, YComponent, ZComponent

# ---- group: frame to orient brushstrokes
divide_curve_2 = DivideCurve(Curve=rebcrv, Count=number_slider_6, Kinks=False)  # -> Points, Tangents, Parameters
horizontal_frame = HorizontalFrame(Curve=rebcrv, Parameter=divide_curve_2.Parameters)

# ---- group: calculate radius based on z-value
python_3_script = Python3Script(brush_size=random_4, pts_z=deconstruct.ZComponent, max_z=max_z_mm)  # -> out, radius; inputs pts_z: list
# ---------- python_3_script: Python ----------
"""
pts: list of Rhino.Geometry.Point3d
max_z: float
max_radius: float
"""

radius = []

for z in pts_z:

    # If above max_z, radius = 0 (do not draw)
    if z > max_z:
        r = 0
    else:
        # Linear mapping: lower Z → larger radius, you can modify formula
        r = (1 - z / max_z) * brush_size

    radius.append(r)
# ---------- end python_3_script ----------

# ----
# Construct TCP moving frames
pl = PlaneNormal(Origin=divide.Points, ZAxis=vec2pt.Vector)
divide_2 = DivideCurve(Curve=reparameterize(rebcrv), Count=number_slider_6, Kinks=False)  # -> Points, Tangents, Parameters
twnthruplnscrv = TweenThroughPlanesOnCurve(
    Planes=pl,
    Curve=nurbs_curve.Curve,
    Factor=divide_2.Parameters,
    Normalized=True,
    Equalized=True,
    Weighted=False,
    Quaternion=True)

# ---- group: save plane
area = Area(Geometry=rectangle.Rectangle)  # -> Area, Centroid
Z_2 = UnitZ(Factor="100")
move_3 = Move(Geometry=area.Centroid, Motion=Z_2)  # -> Geometry, Transform
xy = XYPlane(Origin=move_3.Geometry)

# ----
# transfer frames and planes into command
merge = Merge(Data1=twnthruplnscrv)  # -> flatten(Result)
pflip = FlipPlane(Plane=merge, ReverseX=False, ReverseY=False, SwapAxes=True)
ptp_move = PTPMovementKUKAPrc(TargetAsPlane=pflip, extaxenabled=False, interpolation="C_PTP")
panel_4 = Panel(ptp_move)
safe_plane = SafePlaneKUKAPrc(KUKAPrcCommand=ptp_move, SafePlane=xy, OffsetStart=True, OffsetEnd=True)

# ----
# Kuka PRC
custom_tool = CustomToolKUKAPrc(isExternal=False, toolid=6, toolvala=0, toolvalb=0, toolvalc=0, toolvalx=0, toolvaly=0, toolvalz=240, valuesset=True)
lbr7_r800 = IiwaLBR7R800Robot()
kuka_prc = KUKAPrcCORE(
    SimulationSlider=Slider(0, range=0..1),
    KUKAPrcCommands=safe_plane,
    Tool=custom_tool,
    Robot=lbr7_r800,
    SaveToggle=True,
    Filename="Kukaprc_data",
    PRC_BaseExpose=True,
    PRC_SaveNameExpose=True,
    PRCsettings="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")  # -> RobotGeometry, AnalysisOutput
analysis_kuka_prc = AnalysisKUKAPrc(KUKAPrcAnalysisData=kuka_prc.AnalysisOutput)  # -> RobotAxisValues, RobotCollisionCheck, RobotReachabilityCheck, CommandID, TimeValue, Planes, CommandTags, IOState, Index, KRL
# Display
panel_5 = Panel(analysis_kuka_prc.RobotAxisValues)

# ----
# Draw a brushstroke image
circle = Circle(Plane=horizontal_frame, Radius=python_3_script.radius)
brep_wireframe = BrepWireframe(Brep=rectangle.Rectangle, Density=-1)
colour_rgb = ColourRGB(Alpha=255, Red=0, Green=0, Blue=0)

# ---- group: clean data
null_item = NullItem(Item=circle)  # -> NullFlags, InvalidFlags, Description
dispatch = Dispatch(List=circle, DispatchPattern=null_item.NullFlags)  # -> ListA, ListB

# ---- group: Final Stroke Image
boundary_surfaces = BoundarySurfaces(Edges=dispatch.ListB)

# ----
custom_preview = CustomPreview(Geometry=[boundary_surfaces, brep_wireframe], Material=colour_rgb)
